# Dynamo graph TGNDyn.dyn (Dynamo 3.1.0.4724)

code_block = CodeBlock { "TRE_001_001"; "Matt"; "Matt"; "0.01"; }
meta = TGNNodeCore.Meta.Meta(tag=code_block.out0, approver=code_block.out1, originator=code_block.out2, revision=code_block.out3)
code_block_2 = CodeBlock { "TGN_001_001"; "Matt"; "Matt"; "0.01"; }
meta_2 = TGNNodeCore.Meta.Meta(tag=code_block_2.out0, approver=code_block_2.out1, originator=code_block_2.out2, revision=code_block_2.out3)
code_block_3 = CodeBlock { 10; 2; }
point = TGNNodeCore.Point.Point(x=code_block_3.out0, y=code_block_3.out0, z=code_block_3.out0)
code_block_4 = CodeBlock { 0; 1; 0; }
axis = TGNNodeCore.Axis.Axis(rX=code_block_4.out0, rY=code_block_4.out1, rZ=code_block_4.out2)
plane = TGNNodeCore.Plane.Plane(point=point, axis=axis)
focuscube = TGNNodeCore.Focuscube.Focuscube(plane=plane, width=code_block_3.out0, depth=code_block_3.out0, height=code_block_3.out0)
sub = code_block_3.out0 - code_block_3.out1
point_2 = TGNNodeCore.Point.Point(x=sub, y=code_block_3.out1, z=code_block_3.out0)
point_3 = TGNNodeCore.Point.Point(x=code_block_3.out0, y=sub, z=code_block_3.out0)
add = code_block_3.out0 + code_block_3.out1
point_4 = TGNNodeCore.Point.Point(x=add, y=code_block_3.out1, z=code_block_3.out0)
camerapath = TGNNodeCore.Camerapath.Camerapath(oPlane=plane, sPoint=point_2, cPoint=point_3, ePoint=point_4)
code_block_5 = CodeBlock { 30; }
camera = TGNNodeCore.Camera.Camera(cPath=camerapath, fPoint=point, focalLength=code_block_5)
code_block_6 = CodeBlock { 1; }
canvas = TGNNodeCore.Canvas.Canvas(oPlane=plane, scale=code_block_6)
rig = TGNNodeCore.Rig.Rig(meta=meta_2, focusCube=focuscube, cameraPath=camerapath, camera=camera, canvas=canvas)
list_create = List.Create(item0=rig)
TRE = TGNNodeCore.TRE.TRE(meta=meta, rigs=list_create)
tre = TGNNodeCore.TRE.tre(tRE=TRE)
code_block_7 = CodeBlock(x=tre) { x[0]; }
meta_3 = TGNNodeCore.Rig.meta(rig=code_block_7)
approver = TGNNodeCore.Meta.approver(meta=meta_3)
originator = TGNNodeCore.Meta.originator(meta=meta_3)
revision = TGNNodeCore.Meta.revision(meta=meta_3)
tag = TGNNodeCore.Meta.tag(meta=meta_3)
focusCube = TGNNodeCore.Rig.focusCube(rig=code_block_7)
plane_2 = TGNNodeCore.Focuscube.plane(focuscube=focusCube)
meta_4 = TGNNodeCore.TRE.meta(tRE=TRE)
originator_2 = TGNNodeCore.Meta.originator(meta=meta_4)
tag_2 = TGNNodeCore.Meta.tag(meta=meta_4)
approver_2 = TGNNodeCore.Meta.approver(meta=meta_4)
revision_2 = TGNNodeCore.Meta.revision(meta=meta_4)
